vi "Main Window.gvi"   [LabVIEW NXG 5.0.0]
panel controls:
  "Acquire Button": bool
  "Load Measurement": bool
  "Save Measurement": bool
  "JV Curve Parameters": "JV Curve Parameters.gtype"
  "Main Tab": i32
  "Custom date": bool
  "Author Initials": string
  "Batch Name": string
  "Cell Number": string
  "Sample Comments": string
  "Abort Button": bool
  "Exit App Button": bool
  "Add Layer Button": bool
  "Add Layer Button_2": bool
  "Add Layer Button_3": bool
  "Label Info Error Label": string
  "Label Info Missing Error": bool
  "Config Tab": i32
  "Misc Data Mega Cluster": "Misc Mega Cluster.gtype"
  "Instrument Control Mega Cluster": "Instrument Control Mega Cluster.gtype"
  "Desired Cell": "Cell Selector.gtype" = "L.01"
  "Set Cell": bool
  "Cell Parameters": "Cell Parameters.gtype" = {"Max (V)"=1, "Min (V)"=-0.2, "Sweep Dir"=FALSE, "Curr Range (A)"=0.1, "Autorange"=TRUE, "Max (A)"=1, "Cell Area (m^2)"=8e-06, "Light Power (W m^-2)"=1000}
  "JV Scan Mode": "JV Scan Mode.gtype" = "Rough"
  "Measurement Precision": "Accuracy Parameters.gtype"
  "Default Data Saving Location": path
  "Cell Selector": "Cell Selector.gtype"
  "JV Measurements Mega Cluster": "JV Measurements Mega Cluster.gtype"
panel indicators:
  "Current Date": string
  "Progress %": f64
  "State": string
  "Substate": string
  "Sample Prefix": string
  "Progress counter": f64
  "Layer Information": string[]
  "Live IV Parameters": "Live IV Parameters.gtype"
  "JV Main Graph": f64[]
  "Current State": "Queue Instructions Control.gtype"
  "Elapsed Time (kr)": f64
  "Estimated Time (kr)": f64
types:
  "Cell Parameters.gtype" = cluster{"Max (V)": f64, "Min (V)": f64, "Sweep Dir": bool, "Curr Range (A)": f64, "Autorange": bool, "Max (A)": f64, "Cell Area (m^2)": f64, "Light Power (W m^-2)": f64}
  "Accuracy Parameters.gtype" = cluster{"V Points": u32, "Current Avg": u32, "Integration Time": f64, "Iterations": u32, "Rs Rsh Slope points": u32}
  "JV Scan Mode.gtype" = enum{"Rough", "Normal", "Accurate", "Smart", "Custom"}
  "JV Curve Parameters.gtype" = cluster{"Cell Parameters": "Cell Parameters.gtype", "Measurement Precision": "Accuracy Parameters.gtype", "JV Scan Mode": "JV Scan Mode.gtype"}
  "Live IV Parameters.gtype" = cluster{"Current (A)": f64, "Voltage (V)": f64, "Cur Density (A/m^2)": f64, "Current Cell": enum{""}}
  "Full Reference Cluster.gtype" = cluster{"Status Report": "Status Report.gtype", "Path Cluster": "Path Cluster.gtype", "Sample Naming Cluster": "Sample Naming Cluster.gtype", "Acquisition Parameters": "Acquisition Parameters.gtype", "Live Progress Cluster": "Live Progress.gtype", "Sample Extra Information": "Sample extra imformation.gtype"}
  "Misc Mega Cluster.gtype" = cluster{"Full Reference Cluster": "Full Reference Cluster.gtype"}
  "Queue Instructions Control.gtype" = enum{"Undefined State", "Debug Check", "Initialize App", "Idle", "Change Cell", "IV Curves Acquisition", "Saving TXT Files", "Generating Origin Files", "Stopping App", "State 1", "State2", "State3", "State4", "State5"}
  T1 = cluster{"Element 1": "VISA Instr", "Element 2": string}
  T2 = enum{"Keithley 2400 Series", "Keithley 2450 Series"}
  "Instrument Control.gtype" = cluster{"Multiplexer Arduino Detected?": bool, "Multiplexer Arduino Address": "VISA Instr", "Arduinos List": T1[], "Multiplexer Log": string, "Keythley Address": "VISA Instr", "Keithley Detected?": bool, "Keithley ID": string, "Detected Keithley Type": T2}
  "Debugging Cluster.gtype" = cluster{"Debugging mode?": bool, "Initialize App": bool, "Insturment Debugging": cluster{"Keithley": bool, "Arduino": bool}}
  "Instrument Control Mega Cluster.gtype" = cluster{"Instrument Control": "Instrument Control.gtype", "Debugging Cluster": "Debugging Cluster.gtype"}
  "Cell Selector.gtype" = enum{"L.01", "L.02", "L.03", "L.04", "L.05", "L.06", "L.07", "L.08", "L.09", "L.10", "L.11", "L.12", "R.01", "R.02", "R.03", "R.04", "R.05", "R.06", "R.07", "R.08", "R.09", "R.10", "R.11", "R.12", "Custom"}
  "JV Data Cluster.gtype" = cluster{"Voltage (V)": f64[], "Current (A)": f64[], "Current Density (A/m^2)": f64[], "Cell Area (m^2)": f64, "Illumination (W/m^2)": f64, "Voc (V)": f64, "Jsc (A/m^2)": f64, "FF (%)": f64, "Rsh (Ω · m^2)": f64, "Rs (Ω · m^2)": f64, "Eff (%)": f64, "Measured Cell": "Cell Selector.gtype", "No Multiplexer": bool}
  "JV Measurements Mega Cluster.gtype" = cluster{"Cell Array": "Cell Selector.gtype"[], "JV Full Data Array": "JV Data Cluster.gtype"[], "JV Curve Parameters": "JV Curve Parameters.gtype", "Cell Selector": "Cell Selector.gtype"}
uses:
  Pika IV Characterization NXG::Side Functions::Abort Control::FGV Global Abort.gvi
  Pika IV Characterization NXG::Main Functions::Instruction Handling::FGV Current State.gvi
  Pika IV Characterization NXG::Side Functions::Timeout::FGV Progress.gvi
  Pika IV Characterization NXG::Side Functions::Timeout::Time Out Subroutine.gvi
  Pika IV Characterization NXG::Side Functions::Exit App Sequence.gvi
  Pika IV Characterization NXG::Side Functions::Utilities::Cell Naming::Sample Naming Subroutine.gvi
  Pika IV Characterization NXG::Side Functions::Utilities::Cell Naming::FGV Sample Prefix.gvi
  Pika IV Characterization NXG::Main Functions::Instruction Handling::Check Queue And Label.gvi
  Pika IV Characterization NXG::Main Functions::Instruction Handling::Condition Enqueue.gvi
  Pika IV Characterization NXG::Main Functions::JV Curves::JV Operation Translation.gvi
  Pika IV Characterization NXG::Side Functions::Instrument Control::Arduino Multiplexer::Set Cell Requisites.gvi
  NI::G Core::Error::Is Error.gvi
  Pika IV Characterization NXG::Side Functions::Abort Control::Abort Sequence.gvi
  Pika IV Characterization NXG::Side Functions::Debugging::Debugging Prompt.gvi
  Pika IV Characterization NXG::Main Functions::Initializing App::Initialize App Subroutine.gvi
  Pika IV Characterization NXG::Side Functions::Instrument Control::Arduino Multiplexer::Set Cell Subroutine.gvi
  Pika IV Characterization NXG::Main Functions::JV Curve Full Subroutine::Full JV Curve Measurement Subroutine.gvi
  NI::G Core::Error::Multiplex Errors.gvi
  NI::G Core::Error::Display Error.gvi
diagram:
  call "FGV Global Abort.gvi"(Global Abort Instructions="Reset State") -> (Error Out=w1)
  call "FGV Current State.gvi"(Current State Instructions="Set Current State and Substate", Current State="Undefined State", Current Substate="Starting Up", Error In=w1) -> (Error Out=w2)
  Obtain Queue(create if not found=TRUE, element data type="Queue Instructions Control.gtype" "Undefined State", error in=w2, name="Instruction Queue") -> (error out=w3, queue out=w4)
  Enqueue Element(element="Debug Check", error in=w3, queue=w4) -> (error out=w5, queue out=w6)
  s1 = w6  # shift register
  while {
    event (timeout = 50) {
      on "Timeout" {
        call "FGV Progress.gvi"(FGV Instructions="Read State", Error In=w5) -> (Progress Out=w10, Elapsed Time Out (kr)=w11, Estimated Time Out (kr)=w12, Error Out=w13)
        $"Progress %" <- w10
        $"Progress counter" <- w10
        $"Estimated Time (kr)" <- w12
        call "Time Out Subroutine.gvi"(Queue In=s1, Misc Data Mega Cluster In=$"Misc Data Mega Cluster", Error In=w13) -> (Queue Out=w8, Misc Data Mega Cluster Out=w14, Stop App?=w9, Error Out=w7)
        $"Misc Data Mega Cluster" <- w14
        $"Elapsed Time (kr)" <- w11
      }
      on "Exit App Button" Value changed {
        call "Exit App Sequence.gvi"(Queue In=s1, Exit App=$"Exit App Button", Error In=w5) -> (Queue Out=w8, Error Out=w7)
        w9 = default
      }
      on "Author Initials" Value changed; "Batch Name" Value changed; "Cell Number" Value changed; "Current Date" Value changed; "Custom date" Value changed; "Sample Comments" Value changed; "Sample Prefix" Value changed {
        call "Sample Naming Subroutine.gvi"(Misc Data Mega Cluster In=$"Misc Data Mega Cluster", Error In=w5) -> (Misc Data Mega Cluster Out=w15, Error Out=w16)
        $"Misc Data Mega Cluster" <- w15
        call "FGV Sample Prefix.gvi"(FGV Instructions="Set State", Misc Mega Cluster In=w15, Error In=w16) -> (Error Out=w7)
        w8 = default
        w9 = default
      }
      on "Acquire Button" Value changed; "Save Measurement" Value changed {
        call "Check Queue And Label.gvi"(Label Info Error Label=$"Label Info Error Label", Label Info Missing Error=$"Label Info Missing Error", Error In=w5, Is Label Necessary?=TRUE) -> (Proceed to enqueue=w17, Error Out=w18)
        call "Condition Enqueue.gvi"(Queue In=s1, Queue Instruction="IV Curves Acquisition", Error In=w18, Equeue?=w17) -> (Queue Out=w8, Error Out=w19)
        call "JV Operation Translation.gvi"(Acquire Button=$"Acquire Button", Load Measurement=FALSE, Save Measurement=$"Save Measurement", Error In=w19) -> (Error Out=w7)
        w9 = default
      }
      on "Load Measurement" Value changed {
        call "Check Queue And Label.gvi"(Label Info Error Label=$"Label Info Error Label", Label Info Missing Error=$"Label Info Missing Error", Error In=w5, Is Label Necessary?=TRUE) -> (Proceed to enqueue=w20, Error Out=w21)
        call "Condition Enqueue.gvi"(Queue In=s1, Queue Instruction="IV Curves Acquisition", Error In=w21, Equeue?=w20) -> (Queue Out=w8, Error Out=w22)
        call "JV Operation Translation.gvi"(Acquire Button=FALSE, Load Measurement=$"Load Measurement", Save Measurement=FALSE, Error In=w22) -> (Error Out=w7)
        w9 = default
      }
      on "Set Cell" Value changed {
        call "Set Cell Requisites.gvi"(Queue In=s1, Instrument Control Mega Cluster=$"Instrument Control Mega Cluster", Error In=w5, Set Cell=$"Set Cell") -> (Queue Out=w8, Error Out=w7)
        w9 = default
      }
    }
    call "Is Error.gvi"(error in=w7) -> (error?=w23)
    Logical Or(w23, w9) -> w24
    next s1 = w8
    stop if w24
  }
  s2 = w6  # shift register
  s3 = w5  # shift register
  while {
    event (timeout = 100) {
      on "Timeout" {
        call "FGV Global Abort.gvi"(Global Abort Instructions="Read Current State", Error In=s3) -> (Global Abort Out=w28, Error Out=w29)
        Preview Queue Element(error in=w29, queue=s2, timeout in ms=100) -> (element=w30, error out=w25, queue out=w26)
        Is Equal(x=w30, y="Stopping App") -> w31
        Logical Or(w31, w28) -> w27
      }
      on "Abort Button" Value changed {
        call "Abort Sequence.gvi"(Queue In=s2, Global Abort=$"Abort Button", Error In=s3) -> (Queue Out=w26, Error Out=w25)
        w27 = default
      }
    }
    next s2 = w26
    next s3 = w25
    stop if w27
  }
  Enqueue Element(element="Stopping App", error in=s3, queue=s2) -> (error out=w32)
  s4 = w6  # shift register
  while {
    Dequeue Element(error in=w5, queue=s4) -> (element=w33, error out=w34, queue out=w35)
    case (w33) {
      frame "Undefined State", Default {
        w36 = w34
        w37 = w35
        w38 = default
      }
      frame "Debug Check" {
        call "Debugging Prompt.gvi"(Instrument Control Mega Cluster In=$"Instrument Control Mega Cluster", Error In=w34) -> (Instrument Control Mega Cluster Out=w39, Error Out=w40)
        Enqueue Element(element="Initialize App", error in=w40, queue=w35) -> (error out=w36, queue out=w37)
        $"Instrument Control Mega Cluster" <- w39
        w38 = default
      }
      frame "Initialize App" {
        call "Initialize App Subroutine.gvi"(Instrument Control Mega Cluster In=$"Instrument Control Mega Cluster", Misc Data Mega Cluster In=$"Misc Data Mega Cluster", Error In=w34) -> (Instrument Control Mega Cluster Out=w41, Misc Data Mega Cluster Out=w42, Error Out=w43)
        $"Instrument Control Mega Cluster" <- w41
        $"Misc Data Mega Cluster" <- w42
        Enqueue Element(element="Idle", error in=w43, queue=w35) -> (error out=w36, queue out=w37)
        w38 = default
      }
      frame "Idle" {
        call "FGV Global Abort.gvi"(Global Abort Instructions="Reset Local", Error In=w34) -> (Error Out=w44)
        call "FGV Current State.gvi"(Current State Instructions="Set Current State and Substate", Current State="Idle", Current Substate="Idle", Error In=w44) -> (Error Out=w45)
        call "FGV Progress.gvi"(FGV Instructions="Reset State", Error In=w45) -> (Error Out=w36)
        w37 = w35
        w38 = default
      }
      frame "Change Cell" {
        call "Set Cell Subroutine.gvi"(Instrument Control Mega Cluster In=$"Instrument Control Mega Cluster", Error In=w34) -> (Instrument Control Mega Cluster Out=w46, Error Out=w47)
        Enqueue Element(element="Idle", error in=w47, queue=w35) -> (error out=w36, queue out=w37)
        $"Instrument Control Mega Cluster" <- w46
        w38 = default
      }
      frame "IV Curves Acquisition" {
        call "Full JV Curve Measurement Subroutine.gvi"(Instrument Control Mega Cluster In=$"Instrument Control Mega Cluster", Misc Data Mega Cluster In=$"Misc Data Mega Cluster", JV Measurements Mega Cluster In=$"JV Measurements Mega Cluster", Error In=w34) -> (Instrument Control Mega Cluster Out=w48, Misc Data Mega Cluster Out=w49, JV Measurements Mega Cluster Out=w50, Error Out=w51)
        $"Instrument Control Mega Cluster" <- w48
        $"Misc Data Mega Cluster" <- w49
        Enqueue Element(element="Idle", error in=w51, queue=w35) -> (error out=w36, queue out=w37)
        $"JV Measurements Mega Cluster" <- w50
        w38 = default
      }
      frame "Stopping App" {
        call "FGV Current State.gvi"(Current State Instructions="Set Current State and Substate", Current State="Stopping App", Current Substate="Bye Bye :D", Error In=w34) -> (Error Out=w36)
        w37 = w35
        w38 = TRUE
      }
    }
    call "Is Error.gvi"(error in=w36) -> (error?=w52)
    Logical Or(w52, w38) -> w53
    call "FGV Global Abort.gvi"(Global Abort Instructions="Reset State", Global Abort=w53, Error In=w36) -> (Error Out=w54)
    next s4 = w37
    stop if w53
  }
  Enqueue Element(element="Stopping App", error in=w54, queue=s4) -> (error out=w55)
  call "Multiplex Errors.gvi"(error in 1=w7, error in 2=w55, error in 3=w32) -> (error out=w56)
  Flush Queue(error in=w56, queue=s1) -> (error out=w57, queue out=w58)
  Release Queue(error in=w57, queue=w58) -> (error out=w59)
  case (w59) {
    frame Error, Default {
      # In case there is an error
      # put out an error handler
      call "Display Error.gvi"(error in=w59)
    }
    frame No Error { }
  }
